# Dynamo graph Example CompoundStructure Create+Modify.dyn (Dynamo 1.3.0.875)

# group: INPUTS
# note: Change Width of layer to...
number_from_feet_and_inches = LengthFromString(0.3048)
# note: Name of Layer Function to set layer to...
string = StringInput("Substrate")
# note: Change Material of layer to...
string_2 = StringInput("Aluminum")

# group: OPERATIONS: CREATE COMPOUND STRUCTURE BY DICTIONARY
# note: PACKAGE: Synthetic
string_3 = StringInput("Autodesk.Revit.DB.MaterialFunctionAssignment")
parse = Synthetic.Core.Enumeration.Parse(string_3, string)
allMaterials = Synthetic.Revit.Select.AllMaterials()
getMaterialByName = Synthetic.Revit.Select.GetMaterialByName(allMaterials, string_2)
code_block = CodeBlock(width=number_from_feet_and_inches, layerFunction=parse, layerMaterial=getMaterialByName) { {"Width", "Layer Function", "Material"}; {width, layerFunction, layerMaterial}; }
byKeysValues = Synthetic.Core.Dictionary.ByKeysValues(code_block.out0, code_block.out1)
unwrap = Synthetic.Core.Dictionary.Unwrap(byKeysValues)
byLayerDictionary = Synthetic.Revit.CompoundStructure.ByLayerDictionary(unwrap)

# group: MONITOR
watch = Watch(byLayerDictionary)

# group: INPUTS
# note: Change Width of layer to...
number_from_feet_and_inches_2 = LengthFromString(0.3048)
# note: Name of Layer Function to set layer to...
string_4 = StringInput("Substrate")
# note: Change Material of layer to...
string_5 = StringInput("Aluminum")

# group: OPERATIONS: CREATE COMPOUND STRUCTURE BY PROPERTIES
# note: PACKAGE: Synthetic
string_6 = StringInput("Autodesk.Revit.DB.MaterialFunctionAssignment")
parse_2 = Synthetic.Core.Enumeration.Parse(string_6, string_4)
allMaterials_2 = Synthetic.Revit.Select.AllMaterials()
getMaterialByName_2 = Synthetic.Revit.Select.GetMaterialByName(allMaterials_2, string_5)
code_block_2 = CodeBlock(width=number_from_feet_and_inches_2, layerFunction=parse_2, layerMaterial=getMaterialByName_2)
# ---------- code_block_2.designscript (3 lines) ----------
{width, width + 1, width +2};
{layerFunction, layerFunction, layerFunction};
{layerMaterial, layerMaterial, layerMaterial};
# ----------------------------------------
byLayerProperties = Synthetic.Revit.CompoundStructure.ByLayerProperties(code_block_2.out0, code_block_2.out1, code_block_2.out2)

# group: MONITOR
watch_2 = Watch(byLayerProperties)

# group: INPUTS
number_slider = DoubleSlider(1, range=0..10 step 1)

# group: OPERATIONS: DELETE LAYER
code_block_3 = CodeBlock(cs=byLayerProperties) { cs; }
deleteLayer = Synthetic.Revit.CompoundStructure.DeleteLayer(code_block_3, number_slider)

# group: MONITOR
watch_3 = Watch(deleteLayer)

# group: INPUTS
number_slider_2 = DoubleSlider(1, range=0..10 step 1)
# note: Change Width of layer to...
number_from_feet_and_inches_3 = LengthFromString(0.3048)
# note: Name of Layer Function to set layer to...
string_7 = StringInput("Structure")
# note: Change Material of layer to...
string_8 = StringInput("Aluminum")

# group: OPERATIONS: INSERT LAYER
code_block_4 = CodeBlock(cs=deleteLayer) { cs; }
# note: PACKAGE: Synthetic
string_9 = StringInput("Autodesk.Revit.DB.MaterialFunctionAssignment")
parse_3 = Synthetic.Core.Enumeration.Parse(string_9, string_7)
allMaterials_3 = Synthetic.Revit.Select.AllMaterials()
getMaterialByName_3 = Synthetic.Revit.Select.GetMaterialByName(allMaterials_3, string_8)
insertLayerAtIndex = Synthetic.Revit.CompoundStructure.InsertLayerAtIndex(code_block_4, number_slider_2, number_from_feet_and_inches_3, parse_3, getMaterialByName_3)

# group: MONITOR
watch_4 = Watch(insertLayerAtIndex)
