# Dynamo graph Example CompoundStructure.dyn (Dynamo 1.3.0.875)

wall_types = WallTypes("Interior - 4 7/8\" Partition (1-hr)")
current = Synthetic.Revit.Document.Current()
fromWallType = Synthetic.Revit.CompoundStructure.FromWallType(wall_types, current)
watch = Watch(fromWallType)
number_from_feet_and_inches = LengthFromString(0.3048)
fromWall = Synthetic.Revit.CompoundStructure.FromWall()  # unwired: arg0
getLayers = Synthetic.Revit.CompoundStructure.GetLayers(fromWall)
layerToList = Synthetic.Revit.CompoundStructure.LayerToList(getLayers)
code_block = CodeBlock(width=number_from_feet_and_inches, lw=layerToList) { index = 1; width; DSCore.List.ReplaceItemAtIndex(lw,index,width); }
byLayerProperties = Synthetic.Revit.CompoundStructure.ByLayerProperties(arg1=code_block.out2)  # unwired: arg0, arg2
watch_2 = Watch(byLayerProperties)
layerByList = Synthetic.Revit.CompoundStructure.LayerByList(code_block.out2)  # unwired: arg1, arg2
toWall = Synthetic.Revit.CompoundStructure.ToWall(wall_types, byLayerProperties)
watch_3 = Watch(toWall)
element_types = ElementTypes("Material")
filterElementClass = Synthetic.Revit.Collector.FilterElementClass(element_types)
byFilters = Synthetic.Revit.Collector.ByFilters(filterElementClass)
toElements = Synthetic.Revit.Collector.ToElements(byFilters)
python_script = Python(IN[0]=toElements)
# ---------- python_script.python (10 lines) ----------
import clr
# Import ToDSType(bool) extension method
clr.AddReference("RevitNodes")
import Revit
clr.ImportExtensions(Revit.Elements)
#The inputs to this node will be stored as a list in the IN variables.


#Assign your output to the OUT variable.
OUT = IN[0][0].InternalElement
# ----------------------------------------
typeOf = Synthetic.Core.Object.TypeOf(python_script)
