# Dynamo graph Example Input.OpenFileDialog.dyn (Dynamo 1.2.1.3083)

string = StringInput("Text (*.txt)|*.txt|All Files (*.*)|*.*")
boolean = BoolSelector(true)
boolean_2 = BoolSelector(true)
dialogFileOpenByOS = Synthetic.Revit.Input.DialogFileOpenByOS(string, boolean, boolean_2)
watch = Watch(dialogFileOpenByOS)
string_2 = StringInput("Show a Test Title")
string_3 = StringInput("Text (*.txt)|*.txt|All Files (*.*)|*.*")
boolean_3 = BoolSelector(true)
dialogFileOpenByRevit = Synthetic.Revit.Input.DialogFileOpenByRevit(string_2, string_3, boolean_3)
watch_2 = Watch(dialogFileOpenByRevit)
string_4 = StringInput("Show a Test Title")
string_5 = StringInput("Text (*.txt)|*.txt|All Files (*.*)|*.*")
boolean_4 = BoolSelector(true)
dialogFileSaveByRevit = Synthetic.Revit.Input.DialogFileSaveByRevit(string_4, string_5, boolean_4)
watch_3 = Watch(dialogFileSaveByRevit)
