# Dynamo graph Example RevitLinkType LoadFrom.dyn (Dynamo 2.0.2.6826)

# group: OPERATION: Get all RevitLinkType
element_types = ElementTypes(index=268)
filterElementClass = Synthetic.Revit.CollectorElementFilter.FilterElementClass(type=element_types)
byFilters = Synthetic.Revit.Collector.ByFilters(filters=filterElementClass)
toElements = Synthetic.Revit.Collector.ToElements(collector=byFilters)

# group: INPUTS
# note: Path to Directory where links are to be repathed
directory_path = Directory("D:\Dropbox\Architecture - SMPC Architects\17026 Del Norte ES")
number_slider = DoubleSlider(2, range=0..100 step 0.1)

# group: OPERATION: Select the Link to be LoadFrom
name = Element.Name(element=toElements)
code_block = CodeBlock(dirPath=directory_path, selectLink=number_slider) { dirPath; selectLink; }
string = StringInput("\")
code_block_2 = CodeBlock(n=code_block.selectLink, l1=toElements, l2=name) { n; l1[n]; l2[n]; }
concat = String.Concat(string0=code_block.dirPath, string1=string, string2=code_block_2.out2)

# group: WATCH
watch = Watch(name)

# group: WATCH
watch_2 = Watch(concat)

# group: OPERATION: LoadFrom
loadFrom = Synthetic.Revit.RevitLinkTypes.LoadFrom(LinkType=code_block_2.out1, FilePath=concat)

watch_3 = Watch(loadFrom)
