# Dynamo graph Example Sheets Create Placeholders.dyn (Dynamo 2.2.1.5175)

file_path = Filename("\\server05\BIM\MCCO\BIM\Sheet List MGE 191115.xls")
file_from_path = FileObject(path=file_path)
string = StringInput("Sheet1")
importExcel = Data.ImportExcel(file=file_from_path, sheetName=string)
transpose = List.Transpose(lists=importExcel)
code_block = CodeBlock(l=transpose) { l[0]; l[1]; }
createPlaceHolderSheet = Synthetic.Revit.Sheet.CreatePlaceHolderSheet(SheetNumber=code_block.out0, SheetTitle=code_block.out1)
watch = Watch(importExcel)
