# Dynamo graph Example Views Renumber on Active Sheet.dyn (Dynamo 1.3.4.6666)

# group: INPUTS
# note: Select -> Titleblock Location Marker family.
family_types_origin_marker = FamilyTypes("Titleblock Grid Location Marker:Locatin Marker INC Titleblock - CD")
# note: Name of Grid Size Parameters
string = StringInput("Grid Size X Direction")
string_2 = StringInput("Grid Size Y Direction")

# group: OPERATIONS
# note: PACKAGE: Synthetic
renumberOnActiveSheet = Synthetic.Revit.View.RenumberOnActiveSheet(family_types_origin_marker, string, string_2)

# group: WATCH: Renumbered Viewports
watch = Watch(renumberOnActiveSheet)
