# Dynamo graph Example Views Renumber on Sheet.dyn (Dynamo 1.3.4.6666)

# group: OPERATION: Get Active Sheet
element_types = ElementTypes("ViewSheet")
filterElementClass = Synthetic.Revit.CollectorElementFilter.FilterElementClass(element_types)
activeView = Synthetic.Revit.View.ActiveView()
id = Synthetic.Revit.Elements.Id(activeView)
byFiltersElemIds = Synthetic.Revit.Collector.ByFiltersElemIds(filterElementClass, id)
toElements = Synthetic.Revit.Collector.ToElements(byFiltersElemIds)
toInt = Synthetic.Revit.ElementId.ToInt(id)

# group: WATCH: List of sheets
name = Element.Name(toElements)
watch = Watch(name)

# group: INPUTS
# note: TRUE: Execute Renumbering
# FALSE: Test graph, but do not renumber.
boolean = BoolSelector(true)
# note: Select -> Titleblock Location Marker family.
family_types = FamilyTypes("Titleblock Grid Location Marker:Locatin Marker INC Titleblock - CD")
# note: TRUE: Project Units = feet
# FALSE: Project Units = inches
boolean_2 = BoolSelector(true)

# group: CONTROL
code_block = CodeBlock { null; }
if_ = If(test=boolean, true=toElements, false=code_block)

# group: OPERATION: Get Origin Marker
filterFamilyInstance = Synthetic.Revit.CollectorElementFilter.FilterFamilyInstance(family_types)
filterElementOwnerViewById = Synthetic.Revit.CollectorElementFilter.FilterElementOwnerViewById(toInt)
create = List.Create(filterFamilyInstance, filterElementOwnerViewById)
filterLogicalAnd = Synthetic.Revit.CollectorElementFilter.FilterLogicalAnd(create)
byFilters = Synthetic.Revit.Collector.ByFilters(filterLogicalAnd)
toElements_2 = Synthetic.Revit.Collector.ToElements(byFilters)

# group: OPERATION: Get Grid Spacing
type = FamilyInstance.Type(toElements_2)
string = StringInput("Grid Size X Direction")
string_2 = StringInput("Grid Size Y Direction")
create_2 = List.Create(string, string_2)
parameterByName = Parameter.ParameterByName(element=type, name=create_2, lacing=CrossProduct)
value = Parameter.Value(parameterByName)
code_block_2 = CodeBlock { 1.0; 12.0; }
if_2 = If(test=boolean_2, true=code_block_2.out0, false=code_block_2.out1)
div = value / if_2
flatten = Flatten(div)

# group: OPERATION: Locate Origin
location = FamilyInstance.Location(toElements_2)
X = Point.X(location)
Y = Point.Y(location)

# group: OPERATION: Renumber Sheets
code_block_3 = CodeBlock(sheet=if_, gridSize=flatten, ptX=X, ptY=Y) { sheet; gridSize[0]; gridSize[1]; ptX; ptY; }
renumberOnSheet = Synthetic.Revit.View.RenumberOnSheet(code_block_3.sheet, code_block_3.out1, code_block_3.out2, code_block_3.ptX, code_block_3.ptY)

watch_2 = Watch(renumberOnSheet)

# group: WATCH: Origin Marker
watch_3 = Watch(toElements_2)

# group: WATCH: Grid Spacing
watch_4 = Watch(flatten)

# group: WATCH: Origin Marker Family Type
watch_5 = Watch(type)

# group: WATCH: Origin Location
watch_6 = Watch(location)
